# Grasshopper definition Uso_e_3D.gh (Grasshopper 1.0.7)
# plug-ins: Mosquito

# Digitar aqui o nome da cidade p/ localizar os dados do OpenStreet Map
panel = Panel("Sorocaba Brazil")
location = MosquitoLocation(Location=panel)  # -> Address, Points, Type
# Esse valor aumenta o raio p/ download dos dados
# Cuidado p/ nao aumentar muito. Pode pesar o arquivo
number_slider = Slider(0.05, range=0..1)
item = ListItem(List=location.Points, Index=0, Wrap=True)
cir = Circle(Plane=item, Radius=number_slider)
toggle = BooleanToggle(True)
# Define True ou False.
# Para carregar ou não informações específicas
toggle_2 = BooleanToggle(True)
# Componente Principal.
# Carrega as infos do OSM.
# Clicar em Reload para carregar a primeira vez
vector_maps = VectorMaps(Area=cir, AllRoads=toggle_2, Buildings=toggle_2, Amenities=toggle, ReProject=toggle, CenterToWorld=toggle)  # -> RoadLines, RoadInfo, BuildingLines, BuildingInfo, BuildingHeights, AmenityLines, AmenityInfo, AmenityPoints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
# Lê as informações de saída dos itens ao qual está ligada
panel_2 = Panel(vector_maps.BuildingInfo)
panel_3 = Panel(vector_maps.RoadInfo)
panel_4 = Panel(vector_maps.AmenityInfo)
Z = UnitZ(Factor=vector_maps.BuildingHeights)
extr = Extrude(Base=vector_maps.BuildingLines, Direction=Z)
cap = CapHoles(Brep=extr)

mindex = MemberIndex(Set=vector_maps.AmenityInfo, Member="amenity = hospital")  # -> Index, Count
dispatch = Dispatch(List=vector_maps.AmenityPoints, DispatchPattern=mindex.Count)  # -> ListA, ListB
colour = ColourPicker(PickedColour=RGB(175, 26, 235))
cir_2 = Circle(Plane=dispatch.ListA, Radius=Slider(179.401, range=0..527))
boundary = BoundarySurfaces(Edges=cir_2)
preview = CustomPreview(Geometry=boundary, Material=colour)

panel_5 = Panel("amenity = parking")

mindex_2 = MemberIndex(Set=vector_maps.BuildingInfo, Member="amenity = bus_station")  # -> Index, Count
dispatch_2 = Dispatch(List=vector_maps.BuildingLines, DispatchPattern=mindex_2.Count)  # -> ListA, ListB
colour_2 = ColourPicker(PickedColour=RGB(26, 235, 148))
cir_3 = Circle(Plane=dispatch_2.ListA, Radius=Slider(109.351, range=0..527))
boundary_2 = BoundarySurfaces(Edges=cir_3)
preview_2 = CustomPreview(Geometry=boundary_2, Material=colour_2)

# ----
# Mudar o parametro aqui.
# Precisa bater com a lista de saída
panel_6 = Panel("amenity = school")
mindex_3 = MemberIndex(Set=vector_maps.AmenityInfo, Member=panel_6)  # -> Index, Count
# Cada bloco em roxo é um grupo de ações para identificar diferentes elementos no MAPA.
# Podem ser alterados mudando os termos de busca.
# É possível criar outros também
panel_7 = Panel(mindex_3.Count)
dispatch_3 = Dispatch(List=vector_maps.AmenityPoints, DispatchPattern=mindex_3.Count)  # -> ListA, ListB
panel_8 = Panel(dispatch_3.ListA)
cir_4 = Circle(Plane=dispatch_3.ListA, Radius=Slider(376.736, range=0..527))
boundary_3 = BoundarySurfaces(Edges=cir_4)
colour_3 = ColourPicker(PickedColour=RGB(224, 26, 235))
preview_3 = CustomPreview(Geometry=boundary_3, Material=colour_3)
